# Grasshopper definition flowers.gh (Grasshopper 1.0.7)
# plug-ins: Pufferfish

Z = UnitZ(Factor=Slider(20, range=0..100))
mesh = Mesh(<mesh referenced from the Rhino model>)
rectangle = Rectangle(Plane="-50,-50,0", XSize="100", YSize="100", Radius=0)  # -> Rectangle, Length
move = Move(Geometry=rectangle.Rectangle, Motion=Z)  # -> Geometry, Transform
pop2d = Populate2D(Region=move.Geometry, Count=300, Seed=1)
mesh_2 = Mesh(<mesh referenced from the Rhino model>)
meshcp = MeshClosestPoint(Point=pop2d, Mesh=mesh)  # -> Point, Index, Parameter
demesh = DeconstructMesh(Mesh=mesh_2)  # -> Vertices, Faces, Colours, Normals
item = ListItem(List=demesh.Vertices, Index=Slider(0, range=0..100), Wrap=True)
move2pt = MoveToPoint(Geometry=mesh_2, PointA=item, PointB=meshcp.Point)  # -> Moved, Vector, Transform
lng = ListLength(List=meshcp.Point)
random = Random(Range="1 to 1.3", Number=lng, Seed="5")
scale = Scale(Geometry=move2pt.Moved, Center=meshcp.Point, Factor=random)  # -> Geometry, Transform
